# Dynamo custom node MatchingIndexestemp.dyf "MatchingIndexes" (Dynamo 2.12.0.5650)
# category: Viktor.ManageList
# Get a list of indexes where the two lists are equal

List1 = Input(List1: var[]..[])
List2 = Input(List2: var[]..[])
matching_indexes = Python(IN[0]=List1, IN[1]=List2)  # IronPython2
# ---------- matching_indexes.python (33 lines) ----------
# Load the Python Standard and DesignScript Libraries
import sys
import clr
clr.AddReference('ProtoGeometry')
from Autodesk.DesignScript.Geometry import *

från_excel = IN[0]
från_spFile = IN[1]
temp = 5
indexes = []
indexes2 = []

loop = len(IN[0])
längd = len(IN[1])


x = 0
for x in range(0, loop):


	y=0
	
	for y in range(0, längd):
		if från_excel[x].lower() == från_spFile[y].lower():
		
			indexes.append(x)
			indexes2.append(y)
			
	y=y+1
	
x=x+1

OUT = indexes,indexes2
# ----------------------------------------
code_block = CodeBlock(indexesList1=matching_indexes) { indexesList1[0]; }
indexesList1 = Output(code_block)
code_block_2 = CodeBlock(indexesList2=matching_indexes) { indexesList2[1]; }
indexesList2 = Output(code_block_2)
