# Dynamo graph setTitleblockParameter_2024.dyn "Sätt Titleblock parameter_2024" (Dynamo 2.19.3.6394)
# author: viktor.wikland@wsp.com
# Klicka på pennan för att öppna inställningarna --- Scriptet låter användaren ändra värden på valfri parameter på titleblock placerade på sheets. Titleblock specificeras antingen genom att markera sheets i project browser eller genom att filtrera på en sträng i namnen på sheets. Det går även att välja att ändra parametervärde för alla titleblocks.

ändra_för_alla_sheets = BoolSelector(true)  # graph input
code_block = CodeBlock { "Title Blocks"; }
byName = Category.ByName(name=code_block)
all_elements_of_category = ElementsOfCategory(Category=byName)
f_filtrera_med_text_t_sheets = BoolSelector(false)  # "F=Filtrera med text T=Sheets markerade i Project browser"; graph input
sheets_selected_in_project = Python()  # "Sheets selected in Project browser"; CPython3; unwired: IN[0]
# ---------- sheets_selected_in_project.python (40 lines) ----------
# Python Code for Dynamo
# Output Selected Elements
# Version 0.1
# Coded by Andrew King
# https://andrewkingme.com
#
# 2018-11-12 Version 0.1
# Hello World

import clr
clr.AddReference('ProtoGeometry')
from Autodesk.DesignScript.Geometry import *

#Import RevitNodes
clr.AddReference("RevitNodes")
import Revit
clr.ImportExtensions(Revit.Elements)

# Import RevitAPI
clr.AddReference('RevitAPI')
import Autodesk
from Autodesk.Revit.DB import *

# Import DocumentManager and TransactionManager
clr.AddReference('RevitServices')
import RevitServices
from RevitServices.Persistence import DocumentManager
from RevitServices.Transactions import TransactionManager

output = []

# Get ElementIds of Revit selection.
selection = DocumentManager.Instance.CurrentUIApplication.ActiveUIDocument.Selection.GetElementIds()

# Convert ElementIds to Revit elements.
for s in selection:
  output.append(DocumentManager.Instance.CurrentDBDocument.GetElement(s).ToDSType(True))

#Assign your output to the OUT variable.
OUT = output
# ----------------------------------------
titleBlock = Sheet.TitleBlock(sheet=sheets_selected_in_project)
flatten = List.Flatten(list=titleBlock)
code_block_2 = CodeBlock { "Sheet Name"; }
getParameterValueByName = Element.GetParameterValueByName(element=all_elements_of_category, parameterName=code_block_2)
string_from_object = FromObject(object=getParameterValueByName)
ändra_parametervärde_för_sheets = StringInput("en textsträng från var som i Sheet_name. (OBS Versalkänslig)")  # "Ändra parametervärde för sheets vars namn innehåller:"; graph input
contains = String.Contains(string=string_from_object, searchFor=ändra_parametervärde_för_sheets)
filterByBoolMask = List.FilterByBoolMask(list=all_elements_of_category, mask=contains)
if_ = RefactoredIf(test=f_filtrera_med_text_t_sheets, true=flatten, false=filterByBoolMask.in)
if_2 = RefactoredIf(test=ändra_för_alla_sheets, true=all_elements_of_category, false=if_)
parameterns_namn = StringInput("Preliminär handling")  # graph input
f_bockruta_t_text = BoolSelector(false)  # graph input
parametervärde_om_textruta = StringInput("Beskrivning etc")  # graph input
bockruta_parameter_ikryssad = BoolSelector(false)  # graph input
if_3 = RefactoredIf(test=f_bockruta_t_text, true=parametervärde_om_textruta, false=bockruta_parameter_ikryssad)
setParameterByName = Element.SetParameterByName(element=if_2, parameterName=parameterns_namn, value=if_3)
code_block_3 = CodeBlock { null; }
ne = setParameterByName != code_block_3
anyTrue = List.AnyTrue(list=ne)
code_block_4 = CodeBlock { "Success"; "No parameters set"; }
resultat = RefactoredIf(test=anyTrue, true=code_block_4.out0, false=code_block_4.out1)
resultat_2 = Watch(resultat)  # graph output
